# Grasshopper definition nakagincapsuletower.gh (Grasshopper 1.0.7)
# plug-ins: Semio, Swiftlet

panel = Panel("C:\Git\Studium\PhD\semio\tests\assets\elements\Capsule_Simple.gh")
list = ValueList({"Back", "Side"}, selected="Back")
number_slider = Slider(-5, range=-1000..1000)
parameter = ConstructParameter(Name="Length", Value=Slider(440, range=0..1000))
parameter_2 = ConstructParameter(Name="Entrance", Value=list)
capsules = Integer(Slider(4, range=0..10))
merge = Merge(Data1=parameter, Data3=parameter_2)
xy = XYPlane(Origin=Point(0, 0, 0))
Z = UnitZ(Factor=Slider(300, range=0..1000))
arrlinear = LinearArray(Geometry=xy, Direction=Z, Count=capsules)  # -> Geometry, Transform
cluster = Cluster(
    X=Slider(-400, range=-1000..1000),
    Y=Slider(10, range=-1000..1000),
    Z=0,
    yaw=Slider(0, range=-360..360),
    pitch=Slider(0, range=-360..360),
    roll=Slider(0, range=-360..360))
plan = ConstructPlan(Url=panel, Parameters=merge)  # -> Plan, Hash
panel_2 = Panel(arrlinear.Geometry)
trim = TrimTree(Tree=arrlinear.Geometry, Depth=1)
sobject = ConstructSobject(Pose=trim, Plan=plan.Plan)
link = ConstructLink(Protocol="Simple")
connectable = ConstructConnectable(Sobject=sobject, Link=link)
shift = ShiftList(List=connectable, Shift="-1", Wrap="False")
shift_2 = ShiftList(List=connectable, Shift=1, Wrap="False")
connection = ConstructConnection(Connecting=shift, Connected=shift_2)
item = ListItem(List=sobject, Index=0, Wrap=True)
merge_2 = Merge(Data1=sobject)
layout = ConstructLayout(Sobjects=sobject, Connections=connection, Assembly=item)
run = Boolean(Toggle(False))
server = Text("http://localhost:2999")
merge_3 = Merge(Data1=arrlinear.Geometry)
layout_design = LayoutDesign(Url=server, Layout=layout, Run=run)
panel_3 = Panel("Detailed")
previewplane = PreviewPlane(plane=merge_3, axis_length=Slider(200, range=0..1000))
design = ShowDesign(Design=layout_design, Concepts="Wireframe")
dedesign = DeconstructDesign(Design=layout_design)  # -> Prototypes, Elements
deelement = DeconstructElement(Element=dedesign.Elements)  # -> SobjectId, PlanHash, Pose
previewplane_2 = PreviewPlane(plane=deelement.Pose, axis_length=Slider(100, range=0..1000))
fjs = FormatJsonString(JSONString=deelement.Pose)
panel_4 = Panel(fjs)

# ==== cluster Cluster
X = ClusterInput()
Y = ClusterInput()
Z = ClusterInput()
yaw = ClusterInput()
pitch = ClusterInput()
roll = ClusterInput()
yawpitchroll = NAME(yaw=yaw, pitch=pitch, roll=roll)  # -> t
# ---------- yawpitchroll: Python ----------
from Rhino.Geometry import Transform
from math import radians

t = Transform.RotationZYX(radians(yaw),radians(pitch),radians(roll))
# ---------- end yawpitchroll ----------
pt = ConstructPoint(XCoordinate=X, YCoordinate=Y, ZCoordinate=Z)
xy = XYPlane(Origin=Point(0, 0, 0))
transform = Transform(Geometry=xy, Transform=yawpitchroll)
pl_origin = PlaneOrigin(Base=transform, Origin=pt)
pln = Plane(pl_origin)
pln_2 = ClusterOutput(pln)

# ==== cluster PreviewPlane: Preview a plane with axis colors and naming.
axis_length = ClusterInput()
plane = ClusterInput()
axis_length_2 = Number(axis_length)
plane_2 = Plane(plane)
deplane = DeconstructPlane(Plane=plane_2)  # -> Origin, XAxis, YAxis, ZAxis
line = LineSDL(Start=deplane.Origin, Direction=deplane.YAxis, Length=axis_length_2)
line_2 = LineSDL(Start=deplane.Origin, Direction=deplane.XAxis, Length=axis_length_2)
line_3 = LineSDL(Start=deplane.Origin, Direction=deplane.ZAxis, Length=axis_length_2)
swatch = ColourSwatch(SwatchColor=RGB(235, 52, 79))
swatch_2 = ColourSwatch(SwatchColor=RGB(0, 166, 157))
swatch_3 = ColourSwatch(SwatchColor=RGB(240, 117, 24))
end = EndPoints(Curve=line_2)  # -> Start, End
end_2 = EndPoints(Curve=line)  # -> Start, End
end_3 = EndPoints(Curve=line_3)  # -> Start, End
tag = TextTag(Location=end.End, Text="X", Colour=swatch)
tag_2 = TextTag(Location=end_2.End, Text="Y", Colour=swatch_2)
tag_3 = TextTag(Location=end_3.End, Text="Z", Colour=swatch_3)
preview = CustomPreview(Geometry=line_2, Material=swatch)
preview_2 = CustomPreview(Geometry=line, Material=swatch_2)
preview_3 = CustomPreview(Geometry=line_3, Material=swatch_3)
