# Grasshopper definition kit.gh (Grasshopper 1.0.8)
# Copyright: GNU Lesser General Public License Version 3
# plug-ins: Monoceros

list = ValueList({"O", "U", "‖", "I", "L", "J", "T"}, selected="O")
srf = Surface([<surface referenced from the Rhino model> x4])
srf_2 = Surface([<surface referenced from the Rhino model> x4])
list_2 = ValueList({"L", "|"}, selected="L")
srf_3 = Surface([<surface referenced from the Rhino model> x4])
city_part = CityPart(variant=list)  # -> parts_2, street_2, building_2, backyard_2, cars_2, pedestrian_2
number_slider = Slider(0, range=0..2)
bbox = BoundingBox(Content=srf, Plane=PlaneXY(0, 0, 0), UnionBox=True)  # -> Box, Box_2
bbox_2 = BoundingBox(Content=srf_2, Plane=PlaneXY(0, 0, 0), UnionBox=True)  # -> Box, Box_2
bbox_3 = BoundingBox(Content=srf_3, Plane=PlaneXY(0, 0, 0), UnionBox=True)  # -> Box, Box_2
city_part_2 = CityPart_2(variant=list_2)  # -> ty_2, parts_2, surfaces_2, street_2, building_3, backyard_2, cars_2, pedestrian_2
crv = Curve(<curve referenced from the Rhino model>)
area = Area(Geometry=bbox.Box)  # -> Area, Centroid
area_2 = Area(Geometry=bbox_2.Box)  # -> Area, Centroid
area_3 = Area(Geometry=bbox_3.Box)  # -> Area, Centroid
srf_4 = Surface(crv)
constmodule = ConstructModule(
    ModuleName="o",
    ModulePartPoints=area.Centroid,
    Geometry=srf,
    BasePlane=PlaneXY(0, 0, 0),
    ModulePartDiagonal=Vector(1, 1, 1))
constmodule_2 = ConstructModule(
    ModuleName="c1",
    ModulePartPoints=area_2.Centroid,
    Geometry=srf_2,
    BasePlane=PlaneXY(0, 0, 0),
    ModulePartDiagonal=Vector(1, 1, 1))
popslots = PopulateGeometryWithSlotCenters(Geometry=srf_4, BasePlane=PlaneXY(0, 0, 0), GridSlotDiagonal=Vector(1, 1, 1), Fill=number_slider, Precision=0.5)
panel = Panel("""0
1
3
4""")
constmodule_3 = ConstructModule(
    ModuleName="c2",
    ModulePartPoints=area_3.Centroid,
    Geometry=srf_3,
    BasePlane=PlaneXY(0, 0, 0),
    ModulePartDiagonal=Vector(1, 1, 1))
crv_2 = Curve(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)
entwine = Entwine(Branch0X=city_part_2.parts_2, FlattenInputs=False)
panel_2 = Panel("""0
1
4""")
ruletyp = ConstructTypedRule(ModuleName="o", ConnectorIndex=panel, Type="street")  # -> flatten(Rule)
srf_5 = Surface(crv_2)
ruletyp_2 = ConstructTypedRule(ModuleName="c2", ConnectorIndex=panel_2, Type="street")  # -> flatten(Rule)
panel_3 = Panel("""1
3
4""")
slotall = ConstructSlotWithAllModulesAllowed(SlotPoint=popslots, BasePlane=PlaneXY(0, 0, 0), GridSlotDiagonal=Vector(1, 1, 1))
M = Module(constmodule)
rulebound = ConstructRuleAtBoundary(Module=M, ConnectorIndex=panel)
M_2 = Module(constmodule_2)
entwine_2 = Entwine(Branch0X=entwine, FlattenInputs=False)
ruletyp_3 = ConstructTypedRule(ModuleName="c2", ConnectorIndex="3", Type="c")
M_3 = Module(constmodule_3)
rulebound_2 = ConstructRuleAtBoundary(Module=M_3, ConnectorIndex=panel_2)
popslots_2 = PopulateGeometryWithSlotCenters(Geometry=srf_5, BasePlane=PlaneXY(0, 0, 0), GridSlotDiagonal=Vector(1, 1, 1), Fill=number_slider, Precision=0.5)
ruletyp_4 = ConstructTypedRule(ModuleName=M_2, ConnectorIndex="0", Type="c")
ruletyp_5 = ConstructTypedRule(ModuleName="c1", ConnectorIndex=panel_3, Type="street")  # -> flatten(Rule)
rulebound_3 = ConstructRuleAtBoundary(Module=M_2, ConnectorIndex=panel_3)
merge = Merge(Data1=ruletyp, Data2=rulebound)
mod = Mod(ty=city_part_2.ty_2, ob=city_part_2.parts_2)  # -> M_2, R_2
S = Slot(slotall)
merge_2 = Merge(Data1=ruletyp_2, Data2=rulebound_2, Data3=ruletyp_3)
slotall_2 = ConstructSlotWithAllModulesAllowed(SlotPoint=popslots_2, BasePlane=PlaneXY(0, 0, 0), GridSlotDiagonal=Vector(1, 1, 1))
merge_3 = Merge(Data1=ruletyp_5, Data2=rulebound_3, Data3=ruletyp_4)
ruleindiffunused = IndifferentRulesForUnusedConnectors(Module=M, Rules=merge)  # -> flatten(RulesIndifferent)
wfc = MonocerosWFCSolver(
    Slots=slotall_2,
    Modules=mod.M_2,
    Rules=mod.R_2,
    RandomSeed=42,
    MaxAttempts=10,
    MaxObservations=2147483647,
    MaxTime=0,
    UseShannonEntropy=False)  # -> Out, Slots, Deterministic, Contradictory, Seed, Attempts, Observations
ruleindiffunused_2 = IndifferentRulesForUnusedConnectors(Module=M_2, Rules=merge_3)  # -> flatten(RulesIndifferent)
panel_4 = Panel(mod.M_2)
panel_5 = Panel(mod.R_2)
ruleindiffunused_3 = IndifferentRulesForUnusedConnectors(Module=M_3, Rules=merge_2)  # -> flatten(RulesIndifferent)
merge_4 = Merge(Data1=merge, Data2=ruleindiffunused)
panel_6 = Panel(merge_4)
merge_5 = Merge(Data1=ruletyp, Data2=ruletyp_5, Data4=ruletyp_2)
materialize = MaterializeSlots()  # -> Geometry, Transform
rulepreview = PreviewRules(Modules=mod.M_2, Rules=mod.R_2)
merge_6 = Merge(Data1=merge_3, Data2=ruleindiffunused_2)
merge_7 = Merge(Data1=merge_2, Data2=ruleindiffunused_3)
merge_8 = Merge(Data1=M, Data2=M_2, Data3=M_3)
merge_9 = Merge(Data1=merge_6, Data3=merge_7)
merge_10 = Merge(Data1=merge_4, Data2=merge_9)
rulebound_4 = ConstructRuleAtBoundary()
wfc_2 = MonocerosWFCSolver(
    Slots=slotall_2,
    Modules=merge_8,
    Rules=merge_10,
    RandomSeed=Slider(46, range=0..100),
    MaxAttempts=10,
    UseShannonEntropy=False,
    MaxObservations=2147483647)  # -> Out, Slots, Attempts, Deterministic, Contradictory, Observations
rulepreview_2 = PreviewRules(Modules=merge_8, Rules=merge_10)
data = Data([<modelobject referenced from the Rhino model> x4])
data_2 = Data([<modelobject referenced from the Rhino model> x4])
data_3 = Data([<modelobject referenced from the Rhino model> x4])
entwine_3 = Entwine(Branch00=data, Branch01=data_2, Branch02=data_3, FlattenInputs=True)
materialize_2 = MaterializeModule(Module=M, Slots=wfc_2.Slots)  # -> Geometry, Transform
deconslot = DeconstructSlot(Slot=wfc_2.Slots)  # -> Center, BasePlane, Diagonal, AllowedModuleNames, IsDeterministic, AllowsAllModules, AllowsNothing, IsValid
txt = Text(deconslot.AllowedModuleNames)
tag = TextTag(Location=deconslot.Center, Text=deconslot.AllowedModuleNames)

# ==== cluster CityPart
# ^                                    ^
#    |                                     |
# <-- Constants    Preview -->
# Parameters    External    Local -->
# <-- Meta               |
#      |                       v
#      v
panel = Panel("""O
I
L
T""")
variant = ClusterInput()
variant_2 = Text(variant)
itemindex = ItemIndex(L=panel, I=variant_2)  # -> i; inputs L: list
# ---------- itemindex: Python ----------
#Component Information
#--------------------------------------------------------------------------------------------
if ghenv.Component.RunCount<2:
    #General
    #--------------------------------------------------------------------------------------------
    __author__ = "Ueli Saluz"
    __version__ = "2022.11.18"
    
    ghenv.Component.Name = "ItemIndex"
    ghenv.Component.NickName = "ItemIndex"
    ghenv.Component.Description = "A better IdemIndex"
    ghenv.Component.Message = "VER 1.0"
    ghenv.Component.Category = "Set"
    ghenv.Component.SubCategory = "List"
    
     #Inputs
    #--------------------------------------------------------------------------------------------
    inputIndex=0
    
    ghenv.Component.Params.Input[inputIndex].Name = "List"
    ghenv.Component.Params.Input[inputIndex].NickName = "L"
    ghenv.Component.Params.Input[inputIndex].Description = "Input1 is..."
    ghenv.Component.Params.Input[inputIndex].Optional = False
    inputIndex+=1
    
    ghenv.Component.Params.Input[inputIndex].Name = "Item"
    ghenv.Component.Params.Input[inputIndex].NickName = "I"
    ghenv.Component.Params.Input[inputIndex].Description = "Input2 is..."
    ghenv.Component.Params.Input[inputIndex].Optional = False
    inputIndex+=1
    
    #Outputs
    #--------------------------------------------------------------------------------------------
    outputIndex=0
    
    ghenv.Component.Params.Output[outputIndex].Name = "Index"
    ghenv.Component.Params.Output[outputIndex].NickName = "i"
    ghenv.Component.Params.Output[outputIndex].Description = "Output1 is..."
    outputIndex+=1

i = L.index(I)
# ---------- end itemindex ----------
width = Number("1")
car_proportion = Number(Slider(12, range=0..50))
pedestrian_proportion = Number(Slider(20, range=0..100))
building_width_proportion = Number(Slider(5, range=0..100))

expression = Expression(x=width, Expression="x/2")
neg = Negative(Value=expression)
division = Division(A=width, B=car_proportion)
dom = ConstructDomain(DomainStart=neg, DomainEnd=expression)
dom_2 = ConstructDomain(DomainStart=neg, DomainEnd=expression)
division_2 = Division(A=width, B=pedestrian_proportion)
division_3 = Division(A=width, B=building_width_proportion)
rectangle = Rectangle(Plane=PlaneXY(0, 0, 0), XSize=dom, YSize=dom_2, Radius=0)  # -> Rectangle, Length
neg_2 = Negative(Value=division)
neg_3 = Negative(Value=division_2)
neg_4 = Negative(Value=division_3)
offset = OffsetCurve(Curve=rectangle.Rectangle, Distance=neg_2, Corners=1)
trim = TrimTree(Tree=offset, Depth=1)
offset_2 = OffsetCurve(Curve=trim, Distance=neg_3, Corners=1)
trim_2 = TrimTree(Tree=offset_2, Depth=1)
offset_3 = OffsetCurve(Curve=trim_2, Distance=neg_4, Corners=1)
trim_3 = TrimTree(Tree=offset_3, Depth=1)
sdiff = SolidDifference(BrepsA=trim, BrepsB=trim_2)
sdiff_2 = SolidDifference(BrepsA=rectangle.Rectangle, BrepsB=trim_2)
sdiff_3 = SolidDifference(BrepsA=rectangle.Rectangle, BrepsB=trim)
srf = Surface(trim_2)
srf_2 = Surface(trim_3)
o_backyard = Brep(srf_2)
o_pedestrian = Brep(sdiff)
o_street = Brep(sdiff_2)
o_cars = Brep(sdiff_3)

filter = StreamFilter(Gate=itemindex, Stream0=o_pedestrian)
filter_2 = StreamFilter(Gate=itemindex, Stream0=o_street)
filter_3 = StreamFilter(Gate=itemindex, Stream0=o_cars)
filter_4 = StreamFilter(Gate=itemindex, Stream0=o_backyard)
backyard = Brep(filter_4)
pedestrian = Brep(filter)
street = Brep(filter_2)
cars = Brep(filter_3)
building_height_proportion = Number(Slider(0.4, range=0..2))
roof_height_percentage = Number(Slider(0.1, range=0..2))

multiplication = Multiplication(A=width, B=roof_height_percentage)
tweencrv = TweenCurve(CurveA=trim_2, CurveB=trim_3, Factor=0.5, BlendType=0)
multiplication_2 = Multiplication(A=width, B=building_height_proportion)
sdiff_4 = SolidDifference(BrepsA=srf, BrepsB=trim_3)
Z = UnitZ(Factor=multiplication_2)
addition = Addition(A=multiplication_2, B=multiplication)
Z_2 = UnitZ(Factor=addition)
move = Move(Geometry=trim_3, Motion=Z)  # -> Geometry, Transform
move_2 = Move(Geometry=tweencrv, Motion=Z_2)  # -> Geometry, Transform
extr = Extrude(Base=trim_2, Direction=Z)
move_3 = Move(Geometry=trim_2, Motion=Z)  # -> Geometry, Transform
extr_2 = Extrude(Base=trim_3, Direction=Z)
merge = Merge(Data1=move.Geometry, Data2=move_2.Geometry)
merge_2 = Merge(Data1=move_3.Geometry, Data2=move_2.Geometry)
loft = Loft(Curves=merge_2, Options={Adjust=False, Closed=False, LoftEnds=0, LoftSimp=0, LoftType=0, Rebuild=10, Refit=0.01})
loft_2 = Loft(Curves=merge, Options={Adjust=False, Closed=False, LoftEnds=0, LoftSimp=0, LoftType=0, Rebuild=10, Refit=0.01})
merge_3 = Merge(Data1=sdiff_4, Data2=extr, Data3=loft, Data4=loft_2, Data5=extr_2)
join = BrepJoin(Breps=merge_3)  # -> Breps, Closed
o_building = Brep(join.Breps)

filter_5 = StreamFilter(Gate=itemindex, Stream0=o_building)
building = Brep(filter_5)
merge_4 = Merge(Data1=cars, Data2=pedestrian, Data3=building, Data4=backyard)
parts = Brep(merge_4)
street_2 = ClusterOutput(street)
building_2 = ClusterOutput(building)
backyard_2 = ClusterOutput(backyard)
cars_2 = ClusterOutput(cars)
pedestrian_2 = ClusterOutput(pedestrian)
parts_2 = ClusterOutput(parts)

# ==== cluster CityPart_2
panel = Panel("""L
|""")
list = ValueList({"L", "|"}, selected="L")
variant = ClusterInput()
variant_2 = Text(variant)
itemindex = ItemIndex(L=panel, I=variant_2)  # -> i; inputs L: list; same code as itemindex
width = Number("1")

expression = Expression(x=width, Expression="x/2")
neg = Negative(Value=expression)
dom = ConstructDomain(DomainStart=neg, DomainEnd=expression)
dom_2 = ConstructDomain(DomainStart=neg, DomainEnd=expression)
rectangle = Rectangle(Plane=PlaneXY(0, 0, 0), XSize=dom, YSize=dom_2, Radius=0)  # -> Rectangle, Length
explode = Explode(Curve=rectangle.Rectangle, Recursive=True)  # -> Segments, Vertices
trim = TrimTree(Tree=explode.Segments, Depth=1)
item = ListItem(List=trim, Index=0, Wrap=True)  # -> Item1, Item, Item1_2
merge = Merge(Data1=item.Item1, Data2=item.Item)
join = JoinCurves(Curves=merge, Preserve=False)
trim_2 = TrimTree(Tree=join, Depth=1)

car_proportion = Number(Slider(8, range=1..50))
pedestrian_proportion = Number(Slider(16, range=1..100))
building_width_proportion = Number(Slider(2, range=0..100))

division = Division(A=width, B=car_proportion)
division_2 = Division(A=width, B=pedestrian_proportion)
division_3 = Division(A=width, B=building_width_proportion)
neg_2 = Negative(Value=division_3)
neg_3 = Negative(Value=division)
neg_4 = Negative(Value=division_2)
offset = OffsetCurve(Curve=item.Item1, Distance=neg_3, Corners=1)
trim_3 = TrimTree(Tree=offset, Depth=1)
offset_2 = OffsetCurve(Curve=trim_3, Distance=neg_4, Corners=1)
trim_4 = TrimTree(Tree=offset_2, Depth=1)
offset_3 = OffsetCurve(Curve=trim_4, Distance=neg_2, Corners=1)
trim_5 = TrimTree(Tree=offset_3, Depth=1)
end = EndPoints(Curve=item.Item1)  # -> Start, End
end_2 = EndPoints(Curve=trim_3)  # -> Start, End
end_3 = EndPoints(Curve=trim_4)  # -> Start, End
end_4 = EndPoints(Curve=trim_5)  # -> Start, End
end_5 = EndPoints(Curve=item.Item1_2)  # -> Start, End
ln = Line(StartPoint=end.Start, EndPoint=end_2.Start)
ln_2 = Line(StartPoint=end_2.Start, EndPoint=end_3.Start)
ln_3 = Line(StartPoint=end_3.Start, EndPoint=end_4.Start)
ln_4 = Line(StartPoint=end_4.Start, EndPoint=end_5.End)
ln_5 = Line(StartPoint=end.End, EndPoint=end_2.End)
ln_6 = Line(StartPoint=end_2.End, EndPoint=end_3.End)
ln_7 = Line(StartPoint=end_3.End, EndPoint=end_4.End)
ln_8 = Line(StartPoint=end_4.End, EndPoint=end_5.Start)
merge_2 = Merge(Data1=item.Item1, Data2=ln, Data3=trim_3, Data4=ln_5)
merge_3 = Merge(Data1=trim_3, Data2=ln_2, Data3=trim_4, Data4=ln_6)
merge_4 = Merge(Data1=trim_4, Data2=ln_3, Data3=trim_5, Data4=ln_7)
merge_5 = Merge(Data1=ln_4, Data2=trim_5, Data3=item.Item1_2, Data4=ln_8)
join_2 = JoinCurves(Curves=merge_2, Preserve=False)
join_3 = JoinCurves(Curves=merge_3, Preserve=False)
join_4 = JoinCurves(Curves=merge_4, Preserve=False)
join_5 = JoinCurves(Curves=merge_5, Preserve=False)
trim_6 = TrimTree(Tree=join_2, Depth=1)
trim_7 = TrimTree(Tree=join_3, Depth=1)
merge_6 = Merge(Data1=trim_6, Data2=trim_7)
trim_8 = TrimTree(Tree=join_4, Depth=1)
trim_9 = TrimTree(Tree=join_5, Depth=1)
runion = RegionUnion(Curves=merge_6)
i_cars = Brep(trim_6)
i_pedestrian = Brep(trim_7)
i_building = Brep(trim_8)
i_backyard = Brep(trim_9)
i_street = Brep(runion)

division_4 = Division(A=width, B=car_proportion)
division_5 = Division(A=width, B=pedestrian_proportion)
division_6 = Division(A=width, B=building_width_proportion)
neg_5 = Negative(Value=division_6)
neg_6 = Negative(Value=division_4)
neg_7 = Negative(Value=division_5)
offset_4 = OffsetCurve(Curve=trim_2, Distance=neg_6, Corners=1)
trim_10 = TrimTree(Tree=offset_4, Depth=1)
offset_5 = OffsetCurve(Curve=trim_10, Distance=neg_7, Corners=1)
trim_11 = TrimTree(Tree=offset_5, Depth=1)
offset_6 = OffsetCurve(Curve=trim_11, Distance=neg_5, Corners=1)
trim_12 = TrimTree(Tree=offset_6, Depth=1)
end_6 = EndPoints(Curve=trim_2)  # -> Start, End
end_7 = EndPoints(Curve=trim_10)  # -> Start, End
end_8 = EndPoints(Curve=trim_11)  # -> Start, End
end_9 = EndPoints(Curve=trim_12)  # -> Start, End
end_10 = EndPoints(Curve=item.Item1_2)  # -> Start, End
ln_9 = Line(StartPoint=end_6.Start, EndPoint=end_7.Start)
ln_10 = Line(StartPoint=end_7.Start, EndPoint=end_8.Start)
ln_11 = Line(StartPoint=end_8.Start, EndPoint=end_9.Start)
ln_12 = Line(StartPoint=end_9.Start, EndPoint=end_10.End)
ln_13 = Line(StartPoint=end_6.End, EndPoint=end_7.End)
ln_14 = Line(StartPoint=end_7.End, EndPoint=end_8.End)
ln_15 = Line(StartPoint=end_8.End, EndPoint=end_9.End)
ln_16 = Line(StartPoint=end_9.End, EndPoint=end_10.End)
merge_7 = Merge(Data1=trim_2, Data2=ln_9, Data3=trim_10, Data4=ln_13)
merge_8 = Merge(Data1=trim_10, Data2=ln_10, Data3=trim_11, Data4=ln_14)
merge_9 = Merge(Data1=trim_11, Data2=ln_11, Data3=trim_12, Data4=ln_15)
merge_10 = Merge(Data1=ln_12, Data2=trim_12, Data3=ln_16)
join_6 = JoinCurves(Curves=merge_7, Preserve=False)
join_7 = JoinCurves(Curves=merge_8, Preserve=False)
join_8 = JoinCurves(Curves=merge_9, Preserve=False)
join_9 = JoinCurves(Curves=merge_10, Preserve=False)
trim_13 = TrimTree(Tree=join_6, Depth=1)
trim_14 = TrimTree(Tree=join_7, Depth=1)
merge_11 = Merge(Data1=trim_13, Data2=trim_14)
trim_15 = TrimTree(Tree=join_8, Depth=1)
trim_16 = TrimTree(Tree=join_9, Depth=1)
runion_2 = RegionUnion(Curves=merge_11)
l_cars = Brep(trim_13)
l_pedestrian = Brep(trim_14)
l_building = Brep(trim_15)
l_backyard = Brep(trim_16)
l_street = Brep(runion_2)

panel_2 = Panel(" street-building-backyard side.")
panel_3 = Panel("monoceros.connector.out")
eval = EvaluateCurve(Curve=ln_11, Parameter="0.5")  # -> Point, Tangent, Angle
Z = UnitZ(Factor=1)
xprod = CrossProduct(VectorA=eval.Tangent, VectorB=Z, Unitize=invert(False))  # -> Vector, Length
qal = ModelQuality(Name=panel_3, Value="False")  # -> Quality, Valid, Name, Value, Unit, Definition
concat = Concatenate(FragmentA="Bottom center of the ", FragmentB="north", FragmentC=panel_2)
rev = Reverse(Vector=xprod.Vector)
por = ModelPort(
    Id="n",
    Description=concat,
    Family="s-b-b",
    CompatibleFamilies="s-b-b",
    Point=eval.Point,
    Direction=rev,
    Qualities=qal.Quality)  # -> Port, Valid, Id, Description, Family, CompatibleFamilies, Point, Direction, T, Qualities

filter = StreamFilter(Gate=itemindex, Stream0=ln_15, Stream1=ln_7)
eval_2 = EvaluateCurve(Curve=filter, Parameter="0.5")  # -> Point, Tangent, Angle
Z_2 = UnitZ(Factor=1)
xprod_2 = CrossProduct(VectorA=eval_2.Tangent, VectorB=Z_2, Unitize=invert(False))  # -> Vector, Length
filter_2 = StreamFilter(Gate=itemindex, Stream0="e", Stream1="s")
filter_3 = StreamFilter(Gate=itemindex, Stream0="east", Stream1="south")
concat_2 = Concatenate(FragmentA="Bottom center of the ", FragmentB=filter_3, FragmentC=panel_2)
rev_2 = Reverse(Vector=xprod.Vector)
por_2 = ModelPort(
    Id=filter_2,
    Description=concat_2,
    Family="s-b-b",
    CompatibleFamilies="s-b-b",
    Point=eval_2.Point,
    Direction=xprod_2.Vector,
    Qualities=qal.Quality)  # -> Port, Valid, Id, Description, Family, CompatibleFamilies, Point, Direction, T, Qualities

building_height_proportion = Number(Slider(0.4, range=0..2))
roof_height_percentage = Number(Slider(0.1, range=0..2))
pt = ConstructPoint(XCoordinate=0, YCoordinate=0, ZCoordinate=expression)
txt = Text(pt)
qal_2 = ModelQuality(Name="monoceros.module.center", Value=txt)  # -> Quality, Valid, Name, Value, Unit, Definition
filter_4 = StreamFilter(Gate=itemindex, Stream0=l_street, Stream1=i_street)
filter_5 = StreamFilter(Gate=itemindex, Stream0=l_building, Stream1=i_building)
filter_6 = StreamFilter(Gate=itemindex, Stream0=l_backyard, Stream1=i_backyard)
filter_7 = StreamFilter(Gate=itemindex, Stream0=l_cars, Stream1=i_cars)
filter_8 = StreamFilter(Gate=itemindex, Stream0=l_pedestrian, Stream1=i_pedestrian)
street = Brep(filter_4)
building = Brep(filter_5)

filter_9 = StreamFilter(Gate=itemindex, Stream0=trim_11, Stream1=trim_4)
multiplication = Multiplication(A=width, B=roof_height_percentage)
filter_10 = StreamFilter(Gate=itemindex, Stream0=trim_12, Stream1=trim_5)
multiplication_2 = Multiplication(A=width, B=building_height_proportion)
Z_3 = UnitZ(Factor=multiplication_2)
addition = Addition(A=multiplication_2, B=multiplication)
tweencrv = TweenCurve(CurveA=filter_9, CurveB=filter_10, Factor=0.5, BlendType=0)
Z_4 = UnitZ(Factor=addition)
move = Move(Geometry=filter_9, Motion=Z_3)  # -> Geometry, Transform
move_2 = Move(Geometry=filter_10, Motion=Z_3)  # -> Geometry, Transform
move_3 = Move(Geometry=tweencrv, Motion=Z_4)  # -> Geometry, Transform
merge_12 = Merge(Data1=move.Geometry, Data2=move_3.Geometry)
merge_13 = Merge(Data1=move_2.Geometry, Data2=move_3.Geometry)
loft = Loft(Curves=merge_12, Options={Adjust=False, Closed=False, LoftEnds=0, LoftSimp=0, LoftType=0, Rebuild=10, Refit=0.01})
extr = Extrude(Base=filter_9, Direction=Z_3)
loft_2 = Loft(Curves=merge_13, Options={Adjust=False, Closed=False, LoftEnds=0, LoftSimp=0, LoftType=0, Rebuild=10, Refit=0.01})
extr_2 = Extrude(Base=filter_10, Direction=Z_3)
merge_14 = Merge(Data1=building, Data2=extr, Data3=loft, Data4=loft_2, Data5=extr_2)
join_10 = BrepJoin(Breps=merge_14)  # -> Breps, Closed
cap = CapHoles(Brep=join_10.Breps)
building_2 = Brep(cap)

parts = Brep(building_2)
backyard = Brep(filter_6)
cars = Brep(filter_7)
pedestrian = Brep(filter_8)
merge_15 = Merge(Data1=cars, Data2=pedestrian, Data3=building, Data4=backyard)
surfaces = Brep(merge_15)
parts_2 = ClusterOutput(parts)
surfaces_2 = ClusterOutput(surfaces)
street_2 = ClusterOutput(street)
building_3 = ClusterOutput(building)
backyard_2 = ClusterOutput(backyard)
cars_2 = ClusterOutput(cars)
pedestrian_2 = ClusterOutput(pedestrian)

filter_11 = StreamFilter(Gate=itemindex, Stream0=item.Item, Stream1=item.Item1_2)
eval_3 = EvaluateCurve(Curve=filter_11, Parameter="0.5")  # -> Point, Tangent, Angle
concat_3 = Concatenate(FragmentA="Bottom center of the ", FragmentB="west backyard side.")
Z_5 = UnitZ(Factor=1)
panel_4 = Panel("s2")
xprod_3 = CrossProduct(VectorA=eval_3.Tangent, VectorB=Z_5, Unitize=invert(False))  # -> Vector, Length
filter_12 = StreamFilter(Gate=itemindex, Stream0="s", Stream1="e")

eval_4 = EvaluateCurve(Curve=item.Item1, Parameter="0.5")  # -> Point, Tangent, Angle
xprod_4 = CrossProduct(VectorA=eval_4.Tangent, VectorB=Z_5, Unitize=invert(False))  # -> Vector, Length
qal_3 = ModelQuality(Name=panel_3, Value="True")  # -> Quality, Valid, Name, Value, Unit, Definition
concat_4 = Concatenate(FragmentA="Bottom center of the ", FragmentB="west", FragmentC=" street side.")
por_3 = ModelPort(
    Id="w",
    Description=concat_4,
    Family="s",
    CompatibleFamilies="s",
    Point=eval_4.Point,
    Direction=xprod_4.Vector,
    Qualities=qal_3.Quality)  # -> Port, Valid, Id, Description, Family, CompatibleFamilies, Point, Direction, T, Qualities

filter_13 = StreamFilter(Gate=itemindex, Stream0="s", Stream1="by")

concat_5 = Concatenate(FragmentA="Bottom center of the ", FragmentB="south", FragmentC=" street side.")
filter_14 = StreamFilter(Gate=itemindex, Stream0=qal_3.Quality, Stream1=qal.Quality)
filter_15 = StreamFilter(Gate=itemindex, Stream0=concat_5, Stream1=concat_3)
por_4 = ModelPort(
    Id=filter_12,
    Description=filter_15,
    Family=filter_13,
    CompatibleFamilies=filter_13,
    Point=eval_3.Point,
    Direction=xprod_3.Vector,
    Qualities=filter_14)  # -> Port, Valid, Id, Description, Family, CompatibleFamilies, Point, Direction, T, Qualities

merge_16 = Merge(Data1=por.Port, Data2=por_2.Port, Data3=por_3.Port, Data4=por_4.Port)
typ = ModelType(Name="City Part", Variant=variant_2, Ports=merge_16, Qualities=qal_2.Quality)  # -> Type, Valid, Name, Description, Icon, Image, Variant, Unit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
prv = PreviewPort(po=typ.Ports)
ty = Type(typ.Type)
ty_2 = ClusterOutput(ty)

# ==== cluster Mod
ty = ClusterInput()
ob = ClusterInput()
ty_2 = Type(ty)
ob_2 = Data(ob)
D = ModulePartDiagonal(Vector(1, 1, 1))
panel = Panel(ty_2)
typ = ModelType(Type=ty_2)  # -> Type, Valid, Name, Description, Icon, Image, Variant, Unit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
panel_2 = Panel("""e
n
t
w
s
b""")
por = SelectPort(po=typ.Ports, id=panel_2)  # -> po_4, i_2
qal = SelectQuality(ql=typ.Qualities, na="monoceros.module.center")
expression = Expression(x=D, Expression="x/2")
qal_2 = ModelQuality(Quality=qal)  # -> Quality, Valid, Name, Value, Unit, Definition
por_2 = ModelPort(Port=por.po_4)  # -> Port, Valid, Id, Description, Family, CompatibleFamilies, Point, Direction, T, Qualities
txt = Text(typ.Type)
expression_2 = Expression(x=D, Expression="x/2")
panel_3 = Panel(por_2.Family)
neg = Negative(Value=expression)
expression_3 = Expression(x=por_2.Family, y="indifferent", Expression="If(x=\"\",y,x)")
constmodule = ConstructModule(ModuleName=txt, ModulePartPoints=qal_2.Value, Geometry=ob_2, BasePlane=qal_2.Value, ModulePartDiagonal=D)
box = Box2Pt(PointA=neg, PointB=expression_2, Plane=qal_2.Value)
trim = TrimTree(Tree=por_2.Qualities, Depth=1)
series = Series(Start=0, Step=1, Count="6")  # -> flatten(Series)
qal_3 = SelectQuality(ql=por_2.Qualities, na="monoceros.connector.out")
null = NullItem(Item=por.po_4)  # -> NullFlags, InvalidFlags, Description
M = Module(constmodule)
cull = CullPattern(List=series, CullPattern=invert(null.NullFlags))
cull_2 = CullPattern(List=expression_3, CullPattern=invert(null.NullFlags))
cull_3 = CullPattern(List=por_2.Point, CullPattern=invert(null.NullFlags))
cull_4 = CullPattern(List=qal_3, CullPattern=invert(null.NullFlags))
M_2 = ClusterOutput(M)
ruletyp = ConstructTypedRule(ModuleName=txt, ConnectorIndex=cull, Type=cull_2)
qal_4 = ModelQuality(Quality=cull_4)  # -> Quality, Valid, Name, Value, Unit, Definition
cull_5 = CullPattern(List=cull_3, CullPattern=invert(qal_4.Value))
ruleboundpt = RuleAtBoundaryFromPoint(Modules=M, PointTag=cull_5)
trim_2 = TrimTree(Tree=ruleboundpt, Depth=1)
merge = Merge(Data1=ruletyp, Data2=trim_2)
ruleindiffunused = IndifferentRulesForUnusedConnectors(Module=M, Rules=merge)
trim_3 = TrimTree(Tree=ruleindiffunused, Depth=1)
merge_2 = Merge(Data1=merge, Data2=trim_3)
R = Rule(merge_2)
R_2 = ClusterOutput(R)

# ==== cluster PreviewPort: semio styled preview of ports.
po = ClusterInput()
po_2 = Port(po)
por = ModelPort(Port=po_2)  # -> Port, Valid, Id, Description, Family, CompatibleFamilies, Point, Direction, Locators, T
vdisex = VectorDisplayEx(Point=por.Point, Vector=por.Direction, Colour=ColourSwatch(SwatchColor=RGB(0, 166, 157)), Width=2)
preview = CustomPreview(Geometry=por.Point, Material=ColourSwatch(SwatchColor=RGB(235, 52, 79)))
tag = TextTag(Location=por.Point, Text=por.Id, Colour=ColourSwatch(SwatchColor=RGB(250, 149, 0)))

# ==== cluster SelectQuality: Select a quality by its name. If no quality matches, null is returned.
ql = ClusterInput()
na = ClusterInput()
na_2 = Name(graft(na))
ql_2 = Quality(ql)
qal = ModelQuality(Quality=ql_2)  # -> Quality, Valid, Name, Value, Unit, Definition
expression = Expression(x=qal.Name, y=na_2, Expression="x=y")
cull = CullPattern(List=qal.Quality, CullPattern=expression)
nulltobranch = AddNullToEmptyBranch(D=cull)  # -> R; inputs D: tree
# ---------- nulltobranch: C# ----------
#region Usings
using System;
using System.Linq;
using System.Collections;
using System.Collections.Generic;
using System.Drawing;

using Rhino;
using Rhino.Geometry;

using Grasshopper;
using Grasshopper.Kernel;
using Grasshopper.Kernel.Data;
using Grasshopper.Kernel.Types;
#endregion

public class Script_Instance : GH_ScriptInstance
{

    private void RunScript(DataTree<object> D, ref object R)
    {
        foreach (GH_Path path in D.Paths)
            if (D.Branch(path).Count == 0)
                D.Add(null, path);

        R = D;
    }
}
# ---------- end nulltobranch ----------
trim = TrimTree(Tree=nulltobranch, Depth=1)
ql_3 = Quality(trim)
ql_4 = ClusterOutput(ql_3)

# ==== cluster SelectPort: Select a port with the id. If no port matches, null will be returned.
po = ClusterInput()
id = ClusterInput()
id_2 = Id(graft(id))
po_2 = Port(po)
lng = ListLength(List=po_2)
por = ModelPort(Port=po_2)  # -> Port, Valid, Id, Description, Family, CompatibleFamilies, Point, Direction, T, Qualities
series = Series(Start=0, Step=1, Count=lng)
trim = TrimTree(Tree=series, Depth=1)
expression = Expression(x=por.Id, y=id_2, Expression="x=y")
cull = CullPattern(List=po_2, CullPattern=expression)
cull_2 = CullPattern(List=trim, CullPattern=expression)
nulltobranch = AddNullToEmptyBranch(D=cull_2)  # -> R; inputs D: tree; same code as nulltobranch
nulltobranch_2 = AddNullToEmptyBranch(D=cull)  # -> R; inputs D: tree; same code as nulltobranch
trim_2 = TrimTree(Tree=nulltobranch, Depth=1)
trim_3 = TrimTree(Tree=nulltobranch_2, Depth=1)
i = Integer(trim_2)
po_3 = Port(trim_3)
i_2 = ClusterOutput(i)
po_4 = ClusterOutput(po_3)
